# Grasshopper definition P_03 Mechine Learning optimizing Panels.gh (Grasshopper 1.0.8)
# plug-ins: LunchBoxML, Bifocals, Wombat

fullypn = Curve([<curve referenced from the Rhino model> x3393])
discontinuity = Discontinuity(Curve=fullypn, Level=1)  # -> Points, Parameters
plane_fit = PlaneFit(Points=discontinuity.Points)  # -> Plane, Deviation
project = Project(Geometry=graft(fullypn), Plane=plane_fit.Plane)  # -> Geometry, Transform
curve = Curve(project.Geometry)
boundary_mesh = BoundaryMesh(Polyline=curve)  # -> flatten(Mesh)
C = Slider(20, range=0..100)
series = Series(Start=0, Step=1, Count=C)
range = Range(Domain=Domain(0, 1), Steps=expr("x - 1", C))
integer = Integer(series)
gradient = Gradient(
    LowerLimit=0,
    UpperLimit=1,
    Parameter=range,
    stops=[0: RGB(243, 57, 0), 0.1: RGB(236, 27, 60), 0.2: RGB(210, 0, 118), 0.3: RGB(103, 0, 120), 0.4: RGB(39, 72, 161), 0.5: RGB(1, 192, 229), 0.6: RGB(18, 178, 90), 0.7: RGB(79, 186, 8), 0.8: RGB(220, 237, 32), 0.9: RGB(247, 159, 20), 1: RGB(255, 192, 255)])

explode = Explode(Curve=curve, Recursive=True)  # -> Segments, Vertices
curve_2 = Curve(explode.Segments)
shift_list = ShiftList(List=curve_2, Shift=-1, Wrap=False)
polygon_center = PolygonCenter(Polyline=curve)  # -> CenterV, CenterE, graft(CenterA)
shift_list_2 = ShiftList(List=explode.Vertices, Shift=-1, Wrap=False)
flip_curve = FlipCurve(Curve=shift_list)  # -> Curve, Flag
area = Area(Geometry=curve)  # -> graft(Area), Centroid
curve_3 = Curve(explode.Segments)
length = Length(Curve=curve_3)
line = Line(StartPoint=shift_list_2, EndPoint=polygon_center.CenterA)
angle = Angle(VectorA=curve_2, VectorB=flip_curve.Curve)  # -> Angle, Reflex

# ---- group: Normalize
data = Data(length)
min_max = Slider(2, range=1..5)
bounds = Bounds(Numbers=flatten(data))
remap_numbers = RemapNumbers(Value=data, Source=bounds, Target=min_max)  # -> Mapped, Clipped

data_2 = Data(line)
min_max_2 = Slider(2, range=1..5)
bounds_2 = Bounds(Numbers=flatten(data_2))
remap_numbers_2 = RemapNumbers(Value=data_2, Source=bounds_2, Target=min_max_2)  # -> Mapped, Clipped

data_3 = Data(area.Area)
min_max_3 = Slider(3, range=1..5)
bounds_3 = Bounds(Numbers=flatten(data_3))
remap_numbers_3 = RemapNumbers(Value=data_3, Source=bounds_3, Target=min_max_3)  # -> Mapped, Clipped

data_4 = Data(angle.Angle)
min_max_4 = Slider(3, range=1..5)
bounds_4 = Bounds(Numbers=flatten(data_4))
remap_numbers_4 = RemapNumbers(Value=data_4, Source=bounds_4, Target=min_max_4)  # -> Mapped, Clipped

# ----
digonallength = Data(remap_numbers_2.Mapped)
centerangle = Data(remap_numbers_4.Mapped)
centerangle_2 = Data(remap_numbers_3.Mapped)
edgelength = Data(remap_numbers.Mapped)
param_viewer = ParamViewer(edgelength)
param_viewer_2 = ParamViewer(digonallength)
param_viewer_3 = ParamViewer(centerangle)
param_viewer_4 = ParamViewer(centerangle_2)
merge = Merge(Data1=simplify(edgelength), Data2=simplify(digonallength), Data3=simplify(centerangle), Data4=simplify(centerangle_2))

clean_tree = CleanTree(RemoveNulls=True, RemoveInvalid=True, RemoveEmpty=True, Tree=merge)
k_means_clustering = KMeansClustering(TrainingInputs=clean_tree, OfClusters=C, RandomSeed=42)  # -> Result, Likelihood, Centroids
integer_2 = Integer(k_means_clustering.Result)
member_index = MemberIndex(Set=integer_2, Member=integer)  # -> Index, Count
list_item = ListItem(List=boundary_mesh, Index=member_index.Index, Wrap=True)
param_viewer_5 = ParamViewer(list_item)
custom_preview = CustomPreview(Geometry=list_item, Material=graft(gradient))
